# Grasshopper definition bhom_roomObject_2rdf_exampleFile.gh (Grasshopper 1.0.7)
# plug-ins: BH.UI.Grasshopper

aboxsettings = ABoxSettings(
    IndividualsBaseAddress="www.uni-stuttgart.de",
    ConsiderDefaultPropertyValues=True,
    ConsiderNullOrEmptyPropertyValues=False,
    Component="BH.oM.RDF.ABoxSettings")

tboxsettings = TBoxSettings(
    CustomObjectTypesBaseAddress="http://customizeMeFrom-OntologySettings.TBoxSettings.CustomObjectTypesBaseAddress",
    TreatCustomObjectsWithTypeKeyAsCustomObjectTypes=True,
    CustomobjectsTypeKey="Type",
    Component="BH.oM.RDF.TBoxSettings")

localrepositorysettings = LocalRepositorySettings(
    RepositoryRootPath="C:\Users\diels\source\repos",
    CacheRootPath="C:\ProgramData",
    CacheFileName_RepositoryAllFilePaths="cached_RepositoryAllFilePaths.txt",
    CacheFileName_PropertyInfoFileLines="cached_PropertyInfoFileLines.txt",
    GithubOrganisationURL="https://github.com/BHoM/",
    ReadCacheFiles=True,
    WriteCacheFiles=False,
    Component="BH.oM.RDF.LocalRepositorySettings")

ontologysettings = OntologySettings(
    OntologyTitle=" bhom ontology",
    OntologyDescription="buidling ontology",
    OntologyBaseAddress="www.bhom.org",
    TBoxSettings=tboxsettings,
    ABoxSettings=aboxsettings,
    Component="BH.oM.RDF.OntologySettings")
polyline = Polyline(Component="BH.oM.Geometry.Polyline")
room = Room(Perimeter=polyline, Component="BH.oM.Architecture.Elements.Room")
ttlgraph = TTLGraph(
    IObjects=room,
    OntologySettings=ontologysettings,
    LocalRepositorySettings=localrepositorysettings,
    Component="{ .TTLGraph")
panel = Panel(ttlgraph)
